# Grasshopper definition 0001_basic_training.ghx (Grasshopper 1.0.7)

# ----
# 02_add
number_slider = Slider(0.5, range=0..1)
python = GhPythonScript(x=number_slider, y=Slider(0.65, range=0..1))  # -> out, a
# ---------- python: Python ----------
a = x * y
# ---------- end python ----------
panel = Panel(python.a)

# ----
# 05_loop(for)
number_slider_2 = Slider(30, range=0..100)
series = Series(Start=0, Step=Slider(1, range=0..1), Count=number_slider_2)
python_2 = GhPythonScript(nums=series)  # -> out, output; inputs nums: list
# ---------- python_2: Python ----------
__author__ = "horio"
__version__ = "2022.06.28"

import rhinoscriptsyntax as rs

arr = []
for i in range(len(nums)):
    pt = rs.AddPoint([nums[i], 0, 0])
    rs.RotateObject(pt, [0, 0, 0], 30 * i)
    arr.append(pt)

output = rs.AddInterpCurve(arr)
# ---------- end python_2 ----------

# ----
# 03_make_point_from_range
number_slider_3 = Slider(100, range=0..100)
range = Range(Domain=number_slider_3, Steps=10)
python_3 = GhPythonScript(range=range)  # -> out, a; inputs range: list
# ---------- python_3: Python ----------
import rhinoscriptsyntax as rs
import Rhino.Geometry as rg

points = []

for x in range:
    for y in range:
        for z in range:
            point = rg.Point3d(x, y, z)
            points.append(point)

a = points
# ---------- end python_3 ----------
panel_2 = Panel(python_3.a)

# ----
# 07_rhino module
number_slider_4 = Slider(30, range=0..100)
series_2 = Series(Start=0, Step=Slider(1, range=0..1), Count=number_slider_4)
python_4 = GhPythonScript(nums=series_2, offset=Slider(5, range=0..10))  # -> out, output; inputs nums: list
# ---------- python_4: Python ----------
__author__ = "horio"
__version__ = "2022.09.21"

import rhinoscriptsyntax as rs
import Rhino.Geometry as geo

arr = []
for i in range(len(nums)):
    pt = geo.Point3d(nums[i], 0, 0)
    
    
    if(i % 2 == 0):
        rs.MoveObject(pt, [offset, 0, 0])
    
    rs.RotateObject(pt, [0, 0, 0], 30 * i)
    arr.append(pt)

output = geo.Curve.CreateInterpolatedCurve(arr, 3)
# ---------- end python_4 ----------

# ----
# 06_condition(if)
number_slider_5 = Slider(30, range=0..100)
series_3 = Series(Start=0, Step=Slider(1, range=0..1), Count=number_slider_5)
python_5 = GhPythonScript(nums=series_3, offset=Slider(5, range=0..10))  # -> out, output; inputs nums: list
# ---------- python_5: Python ----------
__author__ = "horio"
__version__ = "2022.06.28"

import rhinoscriptsyntax as rs

arr = []
for i in range(len(nums)):
    pt = rs.AddPoint([nums[i], 0, 0])
    
    if(i % 2 == 0):
        rs.MoveObject(pt, [offset, 0, 0])
        
    rs.RotateObject(pt, [0, 0, 0], 30 * i)
    arr.append(pt)

output = rs.AddInterpCurve(arr)
# ---------- end python_5 ----------

# ----
# 04_variable
python_6 = GhPythonScript()  # -> out, output1, output2, output3, output4, output5
# ---------- python_6: Python ----------
import rhinoscriptsyntax as rs

val1 = 10 #int
val2 = 2.53 #float
val3 = "ABC" #strings
val4 = True #boolean
val5 = rs.AddPoint(0, 0, 0) #geometry point

output1 = val1
output2 = val2
output3 = val3
output4 = val4
output5 = val5
# ---------- end python_6 ----------
python_7 = GhPythonScript()  # -> out, val
# ---------- python_7: Python ----------
val = 10
val = val + 5
# ---------- end python_7 ----------
panel_3 = Panel(python_7.val)
panel_4 = Panel(python_6.output1)
panel_5 = Panel(python_6.output2)
panel_6 = Panel(python_6.output3)
panel_7 = Panel(python_6.output4)
panel_8 = Panel(python_6.output5)

# ----
# 05_List
series_4 = Series(Start=0, Step=1, Count=10)
panel_9 = Panel(series_4)
python_8 = GhPythonScript(input=series_4)  # -> out, output; inputs input: list
# ---------- python_8: Python ----------
__author__ = "horio"
__version__ = "2022.06.28"

import rhinoscriptsyntax as rs

input.append(10)
input.remove(5)
input.pop(0)

output = input
# ---------- end python_8 ----------
panel_10 = Panel(python_8.output)

# ----
# 01_hello, world
python_9 = GhPythonScript()  # -> out, a
# ---------- python_9: Python ----------
a = "hello, world"
# ---------- end python_9 ----------
panel_11 = Panel(python_9.a)
