# Grasshopper definition 0002_sine_hat.ghx (Grasshopper 1.0.7)

r = Slider(30, range=20..50)
dis = Slider(14, range=0..19)
z = Slider(80, range=0..100)
div = Slider(21, range=5..50)
shift = Slider(7, range=0..10)
ribbon = Slider(4.4, range=1..10)
python = GhPythonScript(r=r, dis=dis, z=z, div=div, shift=shift, ribbon=ribbon)  # -> out, a, b, c, d, e
# ---------- python: Python ----------
__author__ = "horio"
__version__ = "2022.09.26"

import rhinoscriptsyntax as rs
import Rhino.Geometry as rg
import ghpythonlib.components as gh
import math

circles = []

circle1 = rs.AddCircle([0, 0, 0], r)
circles.append(circle1)
pts1 = rs.DivideCurve(circle1, div)

circle2 = rs.AddCircle([0, 0, 0], r - dis)
circle2 = rs.MoveObject(circle2, rg.Vector3d(0, 0, z))
circles.append(circle2)
pts2 = rs.DivideCurve(circle2, div)

a = circles
# ---------- end python ----------
